# Grasshopper definition Tower_strutural analysis_load&wind_karamba.gh (Grasshopper 1.0.7)
# plug-ins: karambaGH

number_slider = Slider(30, range=0..30)
ellipse = Ellipse(Plane=PlaneXY(0, 0, 0), Radius1=Slider(10, range=0..10), Radius2=Slider(20, range=0..20))  # -> Ellipse, Focus1, Focus2
series = Series(Start=0, Step=Slider(4, range=0..10), Count=number_slider)
Z = UnitZ(Factor=series)
move = Move(Geometry=ellipse.Ellipse, Motion=Z)  # -> Geometry, Transform
area = Area(Geometry=move.Geometry)  # -> Area, Centroid
series_2 = Series(Start=0, Step=Slider(7, range=0..180), Count=number_slider)
rotate = Rotate(Geometry=move.Geometry, Angle=degrees(series_2), Plane=area.Centroid)  # -> Geometry, Transform
item = ListItem(List=rotate.Geometry, Index="0", Wrap=True)
item_2 = ListItem(List=rotate.Geometry, Index="-1", Wrap=True)
boundary = BoundarySurfaces(Edges=[item, item_2])
loft = Loft(Curves=rotate.Geometry, Options={Adjust=False, Closed=False, LoftEnds=0, LoftSimp=0, LoftType=0, Rebuild=10, Refit=0.01})

join = BrepJoin(Breps=[loft, boundary])  # -> Breps, Closed

geo = Geometry(loft)
mesh_uv = MeshSurface(Surface=geo, UCount=Slider(10, range=0..10), VCount=Slider(24, range=0..100), Overhang=True, Equalize=False)  # -> flatten(Mesh)
tri = Triangulate(Mesh=mesh_uv)  # -> Mesh, Count
number_slider_2 = Slider(5, range=0..10)
medges = MeshEdges(Mesh=tri.Mesh)  # -> NakedEdges, InteriorEdges, NonManifoldEdges
line = Line(flatten([medges.NakedEdges, medges.InteriorEdges]))
rdlines = RemoveDuplicateLinesKaramba3D(Line=line, LimitDistance=0.005)  # -> OutLine, Info, Indexes
Z_2 = UnitZ(Factor=1)
linetobeam = LineToBeamKaramba3D(Line=rdlines.OutLine, New=True, Remove=True, LimitDistance_m=0.005)  # -> Element, Points, Info
pdecon = Deconstruct(Point=linetobeam.Points)  # -> XComponent, YComponent, ZComponent
smaller = SmallerThan(FirstNumber=pdecon.ZComponent, SecondNumber=Slider(0.01, range=0..0.01))  # -> SmallerThan, OrEqualTo
cull = CullPattern(List=linetobeam.Points, CullPattern=smaller.SmallerThan)
supp = SupportKaramba3D(PosInd=cull, menu=[buttons(on, on, on, on, on, off)])
license = LicenseKaramba3D()

line_2 = Line(rdlines.OutLine)
lng = ListLength(List=line_2)
multiplication = Multiplication(A=lng, B=Slider(0.433, range=0..1))
reduce = RandomReduce(List=line_2, Reduction=multiplication, Seed=1)

Y = UnitY(Factor=1)
line_3 = LineSDL(Start=linetobeam.Points, Direction=Y, Length=Slider(36, range=0..100))
geo_2 = Geometry(geo)
join_2 = BrepJoin(Breps=flatten(geo_2))  # -> Breps, Closed
bcx = BrepCurve(Brep=join_2.Breps, Curve=line_3)  # -> Curves, Points
lng_2 = ListLength(List=bcx.Points)
smaller_2 = SmallerThan(FirstNumber=lng_2, SecondNumber="2")  # -> flatten(SmallerThan), OrEqualTo
Y_2 = UnitY(Factor=1)
cull_2 = CullPattern(List=linetobeam.Points, CullPattern=smaller_2.SmallerThan)
loads = LoadsKaramba3D(ForceVector=Y_2, Local=False, PosInd=cull_2, LCase=0, mode="Point")

multiplication_2 = Multiplication(A=Slider(100, range=0..100), B=Slider(10, range=0..10))

loads_2 = LoadsKaramba3D(Vector=Z_2, LCase=multiplication_2, mode="Gravity")
assemble = AssembleModelKaramba3D(Elem=linetobeam.Element, Support=supp, Load=loads, LimitDistance_m=0.005)  # -> Model, Info, Mass_kg, CenterOfGravity
analyze = AnalyzeKaramba3D(Model=assemble.Model)  # -> CalculatedModel, MaximumDisplacement_cm, ResultingForceOfGravity_kN, ElasticEnergy_kNm
modelview = ModelViewKaramba3D(Model=analyze.CalculatedModel, ResultFactors=1, ResultCase=-1)  # -> Model, DeformedMesh, DeformedAxes, DeformedModel
b_forces = BeamForcesKaramba3D(AnalyzedModel=analyze.CalculatedModel, LCase=-1, MaximumDistanceBetweenResults_m=-1, NumberOfResultsPerBeamElement=2)  # -> AnalyzedModel, NormalForce_kN, ShearForceVz_kN, ShearForceVy_kN, BendingMomentMt_kNm, BendingMomentMy_kNm, BendingMomentMz_kNm
beamview = BeamViewKaramba3D(Model=modelview.Model)  # -> Model, MeshesOfRenderedBeams, DeformedBeamAxes, LegendColors, LegendTags
