# Grasshopper definition shell(biomorpher)_load_karamba.gh (Grasshopper 1.0.7)
# plug-ins: karambaGH, Biomorpher

gene_pool = GenePool(
    Decimals=2,
    Maximum=30,
    Minimum=0,
    Value=[22.93940354, 6.027084913, 7.336495331, 26.30384656, 3.981696427, 22.27607616, 11.60172594, 8.707700347, 22.96721316, 4.085173236])
number_slider = Slider(30, range=0..50)
dispatch = Dispatch(List=gene_pool, DispatchPattern=[True, False])  # -> ListA, ListB
plane_surface = PlaneSurface(Plane=PlaneXY(0, 0, 0), XSize=number_slider, YSize=number_slider)
vector_xyz = VectorXYZ(XComponent=dispatch.ListA, YComponent=dispatch.ListB, ZComponent=0)  # -> Vector, Length
unit_z = UnitZ(Factor=Slider(20, range=0..30))
move = Move(Geometry=plane_surface, Motion=unit_z)  # -> Geometry, Transform
point = Point(vector_xyz.Vector)
settings_custom = SettingsCustom(
    StitchSeams=True,
    SimplePlanes=False,
    Refine=True,
    MinCount=Slider(16, range=0..100),
    MaxCount=400,
    AspectRatio=20,
    MaxDistance=0,
    MaxAngle=20,
    MinEdge=0,
    MaxEdge=0)
mesh_brep = MeshBrep(Brep=move.Geometry, Settings=settings_custom)
deconstruct_mesh = DeconstructMesh(Mesh=mesh_brep)  # -> Vertices, Faces, Colours, Normals
point_2 = Point(deconstruct_mesh.Vertices)
closest_point = ClosestPoint(Point=point, Cloud=point_2)  # -> ClosestPoint, CPIndex, Distance
point_3 = Point(closest_point.ClosestPoint)
line = Line(StartPoint=point_3, EndPoint=point)

number_slider_2 = Slider(0, range=0..10)
negative = Negative(Value=Slider(0.594, range=0..1))
mesh_to_shell_karamba3d = MeshToShellKaramba3D(Mesh=mesh_brep, LimitDistance_m=0.005)  # -> Element, Points, Info
support_karamba3d = SupportKaramba3D(PosInd=point_3, menu=[buttons(on, on, on, on, on, on)])
unit_z_2 = UnitZ(Factor=negative)
loads_karamba3d = LoadsKaramba3D(ForceVector=unit_z_2, Local=False, PosInd=deconstruct_mesh.Vertices, LCase=0, mode="Point")
assemble_model_karamba3d = AssembleModelKaramba3D(
    Point=mesh_to_shell_karamba3d.Points,
    Elem=mesh_to_shell_karamba3d.Element,
    Support=support_karamba3d,
    Load=loads_karamba3d,
    LimitDistance_m=0.005)  # -> Model, Info, Mass_kg, CenterOfGravity

mesh_edges = MeshEdges(Mesh=mesh_brep)  # -> NakedEdges, InteriorEdges, NonManifoldEdges
cross_section_karamba3d = CrossSectionKaramba3D(
    FamilyNameOfCrossSection="DefaultCroSec",
    Material=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,
    Diameter_cm=Slider(32.461, range=0..100),
    WallThickness_cm=0.4,
    mode="Circular Hollow")
line_to_beam_karamba3d = LineToBeamKaramba3D(
    Line=[mesh_edges.InteriorEdges, mesh_edges.NakedEdges, line],
    CrossSection=cross_section_karamba3d,
    New=True,
    Remove=True,
    LimitDistance_m=0.005)  # -> Element, Points, Info
assemble_model_karamba3d_2 = AssembleModelKaramba3D(
    Point=line_to_beam_karamba3d.Points,
    Elem=line_to_beam_karamba3d.Element,
    Support=support_karamba3d,
    Load=loads_karamba3d,
    LimitDistance_m=0.005)  # -> Model, Info, Mass_kg, CenterOfGravity

analyze_karamba3d = AnalyzeKaramba3D(Model=assemble_model_karamba3d_2.Model)  # -> CalculatedModel, MaximumDisplacement_cm, ResultingForceOfGravity_kN, ElasticEnergy_kNm
model_view_karamba3d = ModelViewKaramba3D(Model=analyze_karamba3d.CalculatedModel, ResultFactors=1, ResultCase=-1)  # -> Model, DeformedMesh, DeformedAxes, DeformedModel
shell_view_karamba3d = ShellViewKaramba3D(Model=model_view_karamba3d.Model, IndexOfLayer=0)  # -> Model, MeshesOfRenderedShells, LegendColors, LegendTags
beam_view_karamba3d = BeamViewKaramba3D(Model=shell_view_karamba3d.Model)  # -> Model, MeshesOfRenderedBeams, DeformedBeamAxes, LegendColors, LegendTags
biomorpher = Biomorpher(Genome=gene_pool, Geometry=beam_view_karamba3d.MeshesOfRenderedBeams)
