# Grasshopper definition shell_gravity&wind_karamba.gh (Grasshopper 1.0.7)
# plug-ins: karambaGH

# ----
# boundary surface
number_slider = Slider(6, range=0..10)
construct_point = ConstructPoint(XCoordinate=0, YCoordinate=0, ZCoordinate=Slider(3, range=0..10))
construct_point_2 = ConstructPoint(XCoordinate=0, YCoordinate=0, ZCoordinate=number_slider)
ellipse = Ellipse(Plane=PlaneXY(0, 0, 0), Radius1=Slider(8, range=0..10), Radius2=Slider(6, range=0..10))  # -> Ellipse, Focus1, Focus2
ellipse_2 = Ellipse(Plane=construct_point_2, Radius1=Slider(8, range=0..10), Radius2=Slider(6, range=0..10))  # -> Ellipse, Focus1, Focus2
ellipse_3 = Ellipse(Plane=construct_point, Radius1=Slider(5, range=0..10), Radius2=Slider(5, range=0..10))  # -> Ellipse, Focus1, Focus2
loft = Loft(
    Curves=[ellipse.Ellipse, ellipse_3.Ellipse, ellipse_2.Ellipse],
    Options={Adjust=False, Closed=False, LoftEnds=0, LoftSimp=0, LoftType=0, Rebuild=10, Refit=0.01})  # -> flatten(Loft)

license_karamba3d = LicenseKaramba3D()
# Define the structure
mesh_breps_karamba3d = MeshBrepsKaramba3D(
    Brep=loft,
    MeshResolution=Slider(1, range=1..20),
    EdgeRefinementFactor=Slider(0.69, range=0..1),
    PointReduction=False,
    SmoothingStepSize=0,
    SmoothingIterations=5)  # -> Mesh, Info
mesh_to_shell_karamba3d = MeshToShellKaramba3D(Mesh=mesh_breps_karamba3d.Mesh, LimitDistance_m=0.005)  # -> Element, Points, Info

# ----
# Define the support
number_slider_2 = Slider(0.005, range=0..0.01)
deconstruct = Deconstruct(Point=mesh_to_shell_karamba3d.Points)  # -> XComponent, YComponent, ZComponent
smaller_than = SmallerThan(FirstNumber=deconstruct.ZComponent, SecondNumber=number_slider_2)  # -> SmallerThan, OrEqualTo
cull_pattern = CullPattern(List=mesh_to_shell_karamba3d.Points, CullPattern=smaller_than.SmallerThan)
panel = Panel(smaller_than.SmallerThan)

# ----
# -z force
# -x force
number_slider_3 = Slider(25, range=0..25)
negative = Negative(Value=number_slider_3)
unit_z = UnitZ(Factor=negative)
loads_karamba3d = LoadsKaramba3D(ForceVector=unit_z, Local=False, PosInd=mesh_to_shell_karamba3d.Points, LCase=Slider(0, range=0..20), mode="Point")
negative_2 = Negative(Value=Slider(25, range=0..25))
unit_x = UnitX(Factor=negative_2)
loads_karamba3d_2 = LoadsKaramba3D(ForceVector=unit_x, Local=False, PosInd=mesh_to_shell_karamba3d.Points, LCase=Slider(0.99, range=0..20), mode="Point")

support_karamba3d = SupportKaramba3D(PosInd=cull_pattern, menu=[buttons(on, on, on, on, on, on)])
assemble_model_karamba3d = AssembleModelKaramba3D(
    Elem=mesh_to_shell_karamba3d.Element,
    Support=support_karamba3d,
    Load=[loads_karamba3d, loads_karamba3d_2],
    LimitDistance_m=0.005)  # -> Model, Info, Mass_kg, CenterOfGravity
analyze_karamba3d = AnalyzeKaramba3D(Model=assemble_model_karamba3d.Model)  # -> CalculatedModel, MaximumDisplacement_cm, ResultingForceOfGravity_kN, ElasticEnergy_kNm
model_view_karamba3d = ModelViewKaramba3D(Model=analyze_karamba3d.CalculatedModel, ResultFactors=1, ResultCase=-1)  # -> Model, DeformedMesh, DeformedAxes, DeformedModel
shell_view_karamba3d = ShellViewKaramba3D(Model=model_view_karamba3d.Model, IndexOfLayer=0)  # -> Model, MeshesOfRenderedShells, LegendColors, LegendTags
legend = Legend(Colour=shell_view_karamba3d.LegendColors, Tags=shell_view_karamba3d.LegendTags, LegendType=1)
mesh = Mesh(shell_view_karamba3d.MeshesOfRenderedShells)
mesh_edges = MeshEdges(Mesh=mesh)  # -> NakedEdges, InteriorEdges, NonManifoldEdges
